# Grasshopper definition GH_LidarScanningWithFologram.gh (Grasshopper 1.0.7)
# plug-ins: Fologram for Grasshopper, Fologram For Grasshopper Utilities, HAL for Grasshopper

_00_clicktoscan = Button()
_01_visualisescannedregion = BooleanToggle(True)
_02_reset = Button()
# Package(s) Needed: Fologram (https://fologram.com/download)
# Note(s): 1. Make sure the Rhino project is in "mm".
# Tested In: 241224_In Rhino 7_loyweiwin@gmail.com
_00_phone_false_hmd_true = BooleanToggle(True)
_99_numberofrecordeddata = Slider(1000, range=0..1000)
_00_phone_false_hmd_true_2 = Data(_00_phone_false_hmd_true)
_01_visualisescannedregion_2 = Data(_01_visualisescannedregion)
_99_numberofrecordeddata_2 = Data(_99_numberofrecordeddata)
_00_clicktoscan_2 = Data(_00_clicktoscan)
_02_reset_2 = Data(_02_reset)

# ----
# LOY'S OPEN SOURCED SCRIPT
# AUTOMATIC INPUTS
# USER INPUTS
# SCANNING THROUGH FOLOGRAM
augdoc = AugmentedDocument(
    augmented_trigger_0_key=_01_visualisescannedregion,
    augmented_trigger_1_key=_02_reset,
    augmented_trigger_2_key=_00_clicktoscan,
    num_augmented_triggers=3)

# ---- group: SCANNED DATA
# 01
event = EventType(2)
_00_phone_false_hmd_true_3 = Data(_00_phone_false_hmd_true_2)

# ---- group: FOLOGRAM VISUALISATION
_01_visualisescannedregion_3 = Data(_01_visualisescannedregion_2)
T = StateGate(States=_01_visualisescannedregion_3, LinkTarget=sync)

# ----
session_settings = SessionSettings()

# ---- group: RECORD DATA
_02_reset_3 = Data(_02_reset_2)
_00_clicktoscan_3 = Data(_00_clicktoscan_2)
# 02
_99_numberofrecordeddata_3 = Data(_99_numberofrecordeddata_2)

# ---- group: FOLOGRAM VISUALISATION
input_rgba = ColourSwatch(SwatchColor=RGBA(255, 255, 255, 0))
display = DisplayMode(2)

# ---- group: SCANNED DATA
# Record Cloud Data
scan = GetScan(Event=event, Headset=_00_phone_false_hmd_true_3, outputAllData=False)

# ----
scan_2 = DeconstructScan(Scan=scan)  # -> Device, PointCloud

# ---- group: SCANNED DATA (continued)
# MAIN FUNCTION
# UI / OUTPUTS
# PROCESSING FUNCTIONS
# HELPERS
input_cloud = Data(scan_2.PointCloud)

# ---- group: RECORD DATA (continued)
input_cloud_2 = Data(input_cloud)

data_rec = PythonScript(x=input_cloud_2, enable=_00_clicktoscan_3, reset=_02_reset_3, limit=_99_numberofrecordeddata_3)  # -> x; inputs x: tree, enable: Boolean, reset: Boolean, limit: Int32
# ---------- data_rec: Python ----------
# Created by Loy
# Created date: 2024 Dec 22

# Import the DataTree class from Grasshopper, which is essential for managing structured data in Grasshopper
from Grasshopper import DataTree  

# Initialize or reset the global variable 'rec' to an empty DataTree if reset is True or if 'rec' is not already defined
if reset or 'rec' not in globals():  
    rec = DataTree[object]()  # Initialize an empty DataTree with object type branches

# If enabled and not reset, merge the incoming tree 'x' into the existing tree 'rec'
if enable and not reset:  
    rec.MergeTree(x)  # Efficiently combines the structure of 'x' into 'rec'

# If a limit is specified (greater than 0), ensure branches do not exceed the defined limit
if limit > 0:  
    for branch in rec.Branches:  # Iterate over all branches in the DataTree
        if branch.Count > limit:  # Check if the branch exceeds the limit
            branch.RemoveRange(0, branch.Count - limit)  # Remove excess items from the start of the branch

# Assign the modified or unmodified DataTree 'rec' back to the variable 'x' for output or further processing
x = rec
# ---------- end data_rec ----------
input_cloud_pointclouddata = Data(data_rec)

# ---- group: CREATE BOUDNING BOX FOR VISUALISATION
input_cloud_pointclouddata_2 = Data(input_cloud_pointclouddata)

# Visualisation Purposes
bbox = BoundingBox(Content=input_cloud_pointclouddata_2, Plane=PlaneXY(0, 0, 0))  # -> Box, Box_2
output_boundingbox = Data(bbox.Box)

# ---- group: FOLOGRAM VISUALISATION (continued)
output_boundingbox_2 = Data(output_boundingbox)

sync = SyncGeometry(Geometry=output_boundingbox_2, Material=input_rgba, DisplayMode=display)
