# Grasshopper definition GH_PostProcessingPointCloud.gh (Grasshopper 1.0.7)
# plug-ins: HAL for Grasshopper, Fologram for Grasshopper, Volvox

input_referencetrimminggeometry_brep = Brep()
input_postprocessing_bool = BooleanToggle(False)
# Package(s) Needed: (Volvox) https://www.food4rhino.com/en/app/volvox
# Note(s): 1. Make sure the Rhino project is in "mm".
# Tested In: 260125_In Rhino 7_loyweiwin@gmail.com
input_collectedcloud_internalised = PointCloud()
input_postprocessing_bool_2 = Boolean(input_postprocessing_bool)

# ----
# LOY'S OPEN SOURCED SCRIPT
# USER INPUTS
# PROSESSING POINTCLOUD
# 01
# 02
input_collectedcloud_internalised_2 = PointCloud(input_collectedcloud_internalised)

# ----
# AUTOMATIC INPUTS
# Compiling PointCloud Data
decloud = DeconstructPointCloud(PointCloud=input_collectedcloud_internalised_2)  # -> Points, Normals, Colors
cloud = ConstructCloud(Points=decloud.Points, Normals=decloud.Normals, Colors=decloud.Colors)
# MAIN FUNCTION
# UI / OUTPUTS
# PROCESSING FUNCTIONS
# HELPERS
output_consolidatedcloud = Cloud(cloud)

output_consolidatedcloud_2 = Cloud(output_consolidatedcloud)
input_postprocessing_bool_3 = Boolean(input_postprocessing_bool_2)
input_trimminggeometry_brep = Brep(input_referencetrimminggeometry_brep)
vsub = VoxelSubsampling(Size=Slider(10, range=0..10000))
bcrop = BoxCrop(Box=input_trimminggeometry_brep)

# ----
# Post Process PointCloud
cloude = CloudEngine(Cloud=output_consolidatedcloud_2)
cleancloud = CleanCloud(Cloud=cloude)

cloudx = CloudEngineX(Cloud=cleancloud, Run=input_postprocessing_bool_3, Abort=False, Instruction0=vsub, Instruction1=bcrop, showinfo=True)
output_processedcloud = Cloud(cloudx)

# ---- group: Visualisation
output_processedcloud_2 = Cloud(output_processedcloud)
preview = CustomPreview(Geometry=output_processedcloud_2, Material=ColourSwatch(SwatchColor=RGB(0, 0, 0)))

# ----
session_settings = SessionSettings()
